# Dynamo graph PipelineGenerator.dyn (Dynamo 2.8.0.2471)

polygon1_name = Python()  # CPython3; unwired: IN[0], IN[1], IN[2]
# ---------- polygon1_name.python (40 lines) ----------
# Load the Python Standard and DesignScript Libraries
import sys
import clr
clr.AddReference('ProtoGeometry')
from Autodesk.DesignScript.Geometry import *

# The inputs to this node will be stored as a list in the IN variables.
#dataEnteringNode = IN
INDEX_EN = ['A','B','C','D'];
INDEX_NUM = ['1','2','3','4'];
INDEX = [];

if IN[2] == "EN":
    INDEX = INDEX_EN
if IN[2] == "NUM":
    INDEX = INDEX_NUM
"""
# Place your code below this line
def name_concatenation(geo_name:str, geo_number:int, index = INDEX):
    if geo_number > len(index):
        raise ValueError("No more indexes available!")
 
    geo_concat = [geo_name + index[i] for i in range(geo_number)]
    return geo_concat

def name_lst_concatenation(geo_name_lst:list, geo_number:int, index = INDEX):
    if geo_number > len(index):
        raise ValueError("No more indexes available!")
    
    geo_concat = [[geo_name + index[i] for i in range(geo_number)] for geo_name in geo_name_lst]
    return geo_concat


# Assign your output to the OUT variable.
if isinstance(IN[0], str):
    OUT = name_concatenation(IN[0], IN[1])
else:
    OUT = name_lst_concatenation(IN[0], IN[1])
"""
OUT = ""
# ----------------------------------------

# group: Coordinates
points = CodeBlock()
# ---------- points.designscript (10 lines) ----------
p1 = Point.ByCoordinates(2+6,-1);
p2 = Point.ByCoordinates(5,0);
// Line1
line1S = Point.ByCoordinates(0,0,1.5);
line1E = Point.ByCoordinates(3,0,-1);
line1 = [line1S, line2E];
// Line2
line2S = Point.ByCoordinates(8,-1,0);
line2E = Point.ByCoordinates(0,6,0);
line2 = [line2S, line2E];
# ----------------------------------------
polygonCoordList1 = CodeBlock()
# ---------- polygonCoordList1.designscript (6 lines) ----------
p1 = Point.ByCoordinates(2+6+2,-1,0);
p2 = Point.ByCoordinates(2+6+2,1,0);
p3 = Point.ByCoordinates(0+6+2,1,0);
p4 = Point.ByCoordinates(0+6+2,-1,0);
//p5 = Point.ByCoordinates(2+6,-1,6);
p = [p1,p2,p3,p4];
# ----------------------------------------
polygonCoordList2 = CodeBlock()
# ---------- polygonCoordList2.designscript (6 lines) ----------
p1 = Point.ByCoordinates(4,0,6);
p2 = Point.ByCoordinates(4,4,6);
p3 = Point.ByCoordinates(0,4,6);
p4 = Point.ByCoordinates(0,0,6);
p5 = Point.ByCoordinates(4,0,6);
p = [p1,p2,p3,p4];
# ----------------------------------------
cubecoord_length = CodeBlock { cub_coord1 = Point.ByCoordinates(0,0,0); cub_coord2 = Point.ByCoordinates(6,6,2); len1 = 4; len2 = 2; }

# group: XML(query result) Import and Parsing
on_off = BoolSelector(true)
file_path = Filename("..\Workspace\ExtendingJena\target\classes\rdf\query_result.xml")
fileExists = FileSystem.FileExists(path=file_path)
file_from_path = FileObject(path=file_path)
python_script = Python(IN[0]=fileExists, IN[1]=file_from_path)  # CPython3
# ---------- python_script.python (86 lines) ----------
# Load the Python Standard and DesignScript Libraries
import sys
import clr
import ctypes
import xml.etree.ElementTree as ET
sys.path.append(r"C:\Users\nobita_yhe\AppData\Local\Programs\Python\Python310\Lib\site-packages")

clr.AddReference('ProtoGeometry')
from Autodesk.DesignScript.Geometry import *
from xml.dom.minidom import parse, parseString

dir = "r'C:\\Users\\nobita_yhe\\Workspace\\ExtendingJena\\src\\main\\resources\\rdf\\query_result.xml'"
#dir = r'C:\Users\nobita_yhe\Workspace\ExtendingJena\src\main\resources\rdf\query_result.xml'
warn_str = 'File or File Path does not exist.'
res = ''

def xmlParsing2Uri(path=dir):
    """ it returns the list in structure like [[uri1, uri2],...,[uri1, uri2]]"""
    dom = parse(path)
    data = dom.documentElement
    resList = data.getElementsByTagName('result')
    
    res_lst = []
    for res in resList: # handle the <result>...</result>
        ur_lst = []
        for bi in res.getElementsByTagName('binding'): # handle the <binding>...</binding>
            for ur in bi.getElementsByTagName('uri'):
                ur_lst.append(ur.childNodes[0].nodeValue)
        res_lst.append(ur_lst)
        ur_lst = []
    return res_lst


def xml2GeometryString(path=dir):
    """ it returns the list in structure like [[Geomety1, Geomety2],...,[Geomety1, Geomety2]]"""
    dom = parse(path)
    data = dom.documentElement
    resList = data.getElementsByTagName('result')
    seperator = '#'

    res_lst = []
    for res in resList: # handle the <result>...</result>
        ur_lst = []
        for bi in res.getElementsByTagName('binding'): # handle the <binding>...</binding>
            for ur in bi.getElementsByTagName('uri'):
                uri_str = ur.childNodes[0].nodeValue
                geo_index = uri_str.find(seperator) 
                geo_str = uri_str[geo_index+1:]
                ur_lst.append(geo_str)
        res_lst.append(ur_lst)
        ur_lst = []
    return res_lst

def xml2GeoInDynamo(path=dir):
    with open(r'C:\Users\nobita_yhe\Workspace\ExtendingJena\src\main\resources\rdf\query_result.xml', 'r', encoding='utf-8') as file:
        xml_data = file.read()
        dom = parseString(xml_data)
        #dom = parse(xml_data)
        data = dom.documentElement
        resList = data.getElementsByTagName('result')
        seperator = '#'
        
        res_lst = []
        for res in resList: # handle the <result>...</result>
            ur_lst = []
            for bi in res.getElementsByTagName('binding'): # handle the <binding>...</binding>
                for ur in bi.getElementsByTagName('uri'):
                    uri_str = ur.childNodes[0].nodeValue
                    geo_index = uri_str.find(seperator) 
                    geo_str = uri_str[geo_index+1:]
                    ur_lst.append(geo_str)
            res_lst.append(ur_lst)
            ur_lst = []
    return res_lst
    
   

if IN[0] == True:
	dir = IN[1]
	res = xml2GeoInDynamo(dir)
else:
	ctypes.windll.user32.MessageBoxW(0, warn_str, 'Input Exception',1)
	res = warn_str
	
# Assign your output to the OUT variable.
OUT = res
# ----------------------------------------
switcher = CodeBlock(SW=on_off, data=python_script) { SW == "True"? data : null; }
query_result_viewer = Watch(switcher)

# group: Geometry Highlighter
if_inlist = Python(IN[0]=query_result_viewer)  # CPython3; unwired: IN[1]
# ---------- if_inlist.python (49 lines) ----------
# Load the Python Standard and DesignScript Libraries
import sys
import clr
clr.AddReference('ProtoGeometry')
from Autodesk.DesignScript.Geometry import *

# The inputs to this node will be stored as a list in the IN variables.
#dataEnteringNode = IN

def flatten(inp_lst):
# Core: 
#		1. traverse the input list 
#		2. concatenate each two adjacent elements 
#		3. store the concatenation into the output list
#		4. remove the non-list element out of the input list
    out_lst = []
    while True:
        if inp_lst == []:
            break
        for ind, val in enumerate(inp_lst):
            if type(val) == list:
                inp_lst = val + inp_lst[ind+1:]
                break
            else:
                out_lst.append(val)
                inp_lst.pop(ind)
                break
    return out_lst

def inList(res_lst, geo):
    flat_lst = flatten(res_lst)
    res = False
    
    for e in flat_lst:
        if e is None:
            break
        if geo.upper() == e.upper():
            res = True
            break
    return res
	#return geo.upper() == e.upper() for e in flat_lst
    #if geo in flat_lst:
    #    return True
    #return False
	
# Assign your output to the OUT variable.
res_lst = IN[0]
geo_name = IN[1]
OUT = inList(res_lst, geo_name)
# ----------------------------------------
color_palette = ColorPalette({R: 255, G: 0, B: 255, A: 255})
geometry_highlighter = Python(IN[1]=if_inlist, IN[2]=color_palette)  # CPython3; unwired: IN[0]
# ---------- geometry_highlighter.python (22 lines) ----------
# Load the Python Standard and DesignScript Libraries
import sys
import clr
clr.AddReference('ProtoGeometry')
from Autodesk.DesignScript.Geometry import *
clr.AddReference('DSCoreNodes')
from DSCore import *
clr.AddReference('GeometryColor')
from Modifiers import GeometryColor

#cBoid = Cuboid.ByLengths(2,2,2)
color = Color.ByARGB(255,255,0,0) # red

geom = IN[0]
inList = IN[1]
color = IN[2]
o = ''

if inList:
    o = GeometryColor.ByGeometryColor(geom, color)
    
OUT = o
# ----------------------------------------
if_inlist_2 = Python(IN[0]=query_result_viewer)  # CPython3; unwired: IN[1]; same code as if_inlist
geometry_highlighter_2 = Python(IN[1]=if_inlist_2, IN[2]=color_palette)  # CPython3; unwired: IN[0]; same code as geometry_highlighter
if_inlist_3 = Python(IN[0]=query_result_viewer)  # CPython3; unwired: IN[1]; same code as if_inlist
geometry_highlighter_3 = Python(IN[1]=if_inlist_3, IN[2]=color_palette)  # CPython3; unwired: IN[0]
# ---------- geometry_highlighter_3.python (24 lines) ----------
# Load the Python Standard and DesignScript Libraries
import sys
import clr
clr.AddReference('ProtoGeometry')
from Autodesk.DesignScript.Geometry import *
clr.AddReference('DSCoreNodes')
from DSCore import *
clr.AddReference('GeometryColor')
from Modifiers import GeometryColor

#cBoid = Cuboid.ByLengths(2,2,2)
color = Color.ByARGB(255,255,0,0) # red

geom = IN[0]
inList = IN[1]
color = IN[2]
o = ''

if inList:
    o = GeometryColor.ByGeometryColor(geom, color)
#else:
#    o = geom
    
OUT = o
# ----------------------------------------
if_inlist_4 = Python(IN[0]=query_result_viewer)  # CPython3; unwired: IN[1]; same code as if_inlist
geometry_highlighter_4 = Python(IN[1]=if_inlist_4, IN[2]=color_palette)  # CPython3; unwired: IN[0]; same code as geometry_highlighter
if_inlist_5 = Python(IN[0]=query_result_viewer)  # CPython3; unwired: IN[1]; same code as if_inlist
geometry_highlighter_5 = Python(IN[1]=if_inlist_5, IN[2]=color_palette)  # CPython3; unwired: IN[0]; same code as geometry_highlighter
if_inlist_6 = Python(IN[0]=query_result_viewer)  # CPython3; unwired: IN[1]; same code as if_inlist
geometry_highlighter_6 = Python(IN[1]=if_inlist_6, IN[2]=color_palette)  # CPython3; unwired: IN[0]; same code as geometry_highlighter
if_inlist_7 = Python(IN[0]=query_result_viewer)  # CPython3; unwired: IN[1]; same code as if_inlist
geometry_highlighter_7 = Python(IN[1]=if_inlist_7, IN[2]=color_palette)  # CPython3; unwired: IN[0]; same code as geometry_highlighter
geo_list = List.Create(item0=geometry_highlighter, item1=geometry_highlighter_2, item2=geometry_highlighter_3, item3=geometry_highlighter_4, item4=geometry_highlighter_5, item5=geometry_highlighter_6, item6=geometry_highlighter_7)
list_viewer = Watch(geo_list)
watch_3d = Watch3D(list_viewer)

# group: WKT Generator
rdf_prefixes = CodeBlock()
# ---------- rdf_prefixes.designscript (27 lines) ----------
rdf="http://www.w3.org/1999/02/22-rdf-syntax-ns#";
owl="http://www.w3.org/2002/07/owl#";
ogc="http://www.opengis.net/";
my="https://www.inf.bi.ruhr-uni-bochum.de/jena/#";
gml="http://www.opengis.net/ont/gml#";
geo="http://www.opengis.net/ont/geosparql#";
geof="http://www.opengis.net/def/function/geosparql/";
rdfs="http://www.w3.org/2000/01/rdf-schema#";
uom="http://www.opengis.net/def/uom/OGC/1.0/";
sf="http://www.opengis.net/ont/sf#";
xsd="http://www.w3.org/2001/XMLSchema#";
geor="http://www.opengis.net/def/rule/geosparql/";

namespaces = {
	"rdf" : rdf,
	"owl" : owl,
	"ogc" : ogc,
	"my" : my,
	"gml" : gml,
	"geo" : geo,
	"geof": geof,
	"rdfs": rdfs,
	"uom": uom,
	"sf": sf,
	"xsd": xsd,
	"geor": geor
};
# ----------------------------------------
code_block = CodeBlock()
# ---------- code_block.designscript (2 lines) ----------
// Number of Geometries to generate
20;
# ----------------------------------------
geometry_generator = Python(IN[0]=code_block)  # CPython3
# ---------- geometry_generator.python (124 lines) ----------
# Load the Python Standard and DesignScript Libraries
import sys
import clr
clr.AddReference('ProtoGeometry')
from Autodesk.DesignScript.Geometry import *

# Common Geometry Types
POINT = "POINT";
MULTIPOINT = "MULTIPOINT";
LINESTRING = "LINESTRING";
MULTILINESTRING = "MULTILINESTRING";
POLYGON = "POLYGON";
MULTIPOLYGON = "MULTIPOLYGON";
GEOMETRYCOLLECTION = "GEOMETRYCOLLECTION";

# The inputs to this node will be stored as a list in the IN variables.
NUM_MULTIPOLYGON = 10
NUM_POLYGON = 10
NUM_LINESTRING = 10
NUM_POINT = 10

# Input 
NUM_MULTIPOLYGON = IN[0]
#NUM_MULTIPOLYGON = 50
#num = IN[1]

# output container
geo_type_lst = []
geo_lst = []

# Point

# LineString
"""
c=1
geo_data = Arc.ByThreePoints( Point.ByCoordinates(20, 20, 2),
                            Point.ByCoordinates(25, 25, 2),
                            Point.ByCoordinates(40, 10, 2))
geo_name = LINESTRING + str(c)
geo_type = LINESTRING
geo_lst.append((geo_data, geo_name, geo_type))
"""

# Polygon

# Multipolygon
"""
i=1
c=1
for i in range(-NUM_MULTIPOLYGON, NUM_MULTIPOLYGON, 4):
    c+=1
    p1 = Point.ByCoordinates(i, i, 0)
    p2 = Point.ByCoordinates(3+i, 3+i, 3)
    
    geo_data = Cuboid.ByCorners(p1, p2)
    geo_name = MULTIPOLYGON + str(c)
    geo_type = MULTIPOLYGON
    geo_lst.append((geo_data, geo_name, geo_type))

i=1
for i in range(-NUM_MULTIPOLYGON, NUM_MULTIPOLYGON, 4):
    c+=1
    j = i + 10
    p1 = Point.ByCoordinates(i, j, 0)
    p2 = Point.ByCoordinates(3+i, 3+j, 3)
    
    geo_data = Cuboid.ByCorners(p1, p2)
    geo_name = MULTIPOLYGON + str(c)
    geo_type = MULTIPOLYGON
    geo_lst.append((geo_data, geo_name, geo_type))
"""
#################################################
# TOUCH - (c1, c2) (c2, c3)
c = 1
p11 = Point.ByCoordinates(0, 0, 0)
p12 = Point.ByCoordinates(3, 3, 3)
geo_data1 = Cuboid.ByCorners(p11, p12)
geo_name1 = MULTIPOLYGON + str(c)
geo_type1 = MULTIPOLYGON
geo_lst.append((geo_data1, geo_name1, geo_type1))

c = 2
p21 = Point.ByCoordinates(3, 3, 3)
p22 = Point.ByCoordinates(6, 6, 6)
geo_data2 = Cuboid.ByCorners(p21, p22)
geo_name2 = MULTIPOLYGON + str(c)
geo_type2 = MULTIPOLYGON
geo_lst.append((geo_data2, geo_name2, geo_type2))

c = 3
p31 = Point.ByCoordinates(6, 6, 3)
p32 = Point.ByCoordinates(9, 9, 6)
geo_data3 = Cuboid.ByCorners(p31, p32)
geo_name3 = MULTIPOLYGON + str(c)
geo_type3 = MULTIPOLYGON
geo_lst.append((geo_data3, geo_name3, geo_type3))
#################################################
# INTERSECT - (c4, c5) 
c = 4
p41 = Point.ByCoordinates(-3, 0, 0)
p42 = Point.ByCoordinates(-6, -3, 3)
geo_data4 = Cuboid.ByCorners(p41, p42)
geo_name4 = MULTIPOLYGON + str(c)
geo_type4 = MULTIPOLYGON
geo_lst.append((geo_data4, geo_name4, geo_type4))

c = 5
p51 = Point.ByCoordinates(-4, 0, 0)
p52 = Point.ByCoordinates(-7, -3, 3)
geo_data5 = Cuboid.ByCorners(p51, p52)
geo_name5 = MULTIPOLYGON + str(c)
geo_type5 = MULTIPOLYGON
geo_lst.append((geo_data5, geo_name5, geo_type5))
#################################################

c = 6
geo_data6 = Sphere.ByCenterPointRadius(Point.ByCoordinates(-3, -3, -3))
geo_name6 = MULTIPOLYGON + str(c)
geo_type6 = MULTIPOLYGON
#mesh_sphere = Mesh.ByGeometry(sphere1)
geo_lst.append((geo_data5, geo_name5, geo_type5))

# Assign your output to the OUT variable.
OUT = geo_lst
# ----------------------------------------
wkt_converter = Python(IN[0]=geometry_generator, IN[1]=rdf_prefixes.my, IN[2]=rdf_prefixes.geo)  # CPython3
# ---------- wkt_converter.python (154 lines) ----------
# Load the Python Standard and DesignScript Libraries
import sys
import clr
clr.AddReference('ProtoGeometry')
from Autodesk.DesignScript.Geometry import *

# The inputs to this node will be stored as a list in the IN variables.
geo_lst = IN[0]
exampleInstanceNamespace = IN[1] # dataEnteringNode[3];
geoSparqlNamespace = IN[2] # dataEnteringNode[4];

def lineString2WKT():
    wktLiteral = "<sf:LineString>";
    wktLiteral += "<rdf:Description rdf:about='" + exampleInstanceNamespace + str(name) + "'>";
    wktLiteral += "<geo:asWKT rdf:datatype='" + geoSparqlNamespace + "wktLiteral'>";
    wktLiteral += "LINESTRING Z((";
    
    points =  geometry
    originP = points[0];
    
    wktLiteral += str(originP.X) + " " +  str(originP.Y) + " " +  str(originP.Z) # start point
    for i in range(1, len(points)):
        wktLiteral += ", " + str(points[i].X) + " " +  str(points[i].Y) + " " +  str(points[i].Z);       
    wktLiteral += ", " + str(originP.X) + " " +  str(originP.Y) + " " +  str(originP.Z); # end point
    wktLiteral += "))"
    
    wktLiteral += "</geo:asWKT>";
    wktLiteral += "</rdf:Description>";
    wktLiteral += "</sf:LineString>";
    return wktLiteral

def multipolygon2WKT(geometry):
    wktLiteral = "<sf:MultiPolygon>";
    wktLiteral += "<rdf:Description rdf:about='" + exampleInstanceNamespace + str(name) + "'>";
    wktLiteral += "<geo:asWKT rdf:datatype='" + geoSparqlNamespace + "wktLiteral'>";
    
    """
    # for curves/surfaces
    wktLiteral += "MULTIPOLYGON Z(((";
    try:
        curves = Surface.PerimeterCurves(geometry);
    except:
        raise Exception("something wrong at geometry import!")
    startP = None;
    for curve in curves:
        nextP = curve.StartPoint;
        if(startP != None):
            wktLiteral += ", ";
        else:
            startP = nextP;
        wktLiteral += str(nextP.X) + " " +  str(nextP.Y) + " " +  str(nextP.Z);
        
    #Close the tiangle loop with a repeat of the first Point
    wktLiteral += ", " + str(startP.X) + " " +  str(startP.Y) + " " +  str(startP.Z);
    wktLiteral += ")))"
    """
    # for cuboids with geometry = [centroid, length]
    centroid = Solid.Centroid(geometry)
    offset = geometry.Length/2
    c_X = centroid.X
    c_Y = centroid.Y
    c_Z = centroid.Z

    # idea: determine the coordinates of bottom- and top faces
    
    # p1 -- p2
    # |  c   |
    # p3 -- p4           
    # bottom-face
    bottom_p1 = str(c_X-offset) + " " + str(c_Y-offset) + " " + str(c_Z-offset)
    bottom_p2 = str(c_X-offset) + " " + str(c_Y+offset) + " " + str(c_Z-offset) 
    bottom_p3 = str(c_X+offset) + " " + str(c_Y+offset) + " " + str(c_Z-offset)
    bottom_p4 = str(c_X+offset) + " " + str(c_Y-offset) + " " + str(c_Z-offset)
    bottom_face = "((" + bottom_p1 + ", " + bottom_p2 + ", " + bottom_p3 + ", " + bottom_p4 +  ", " + bottom_p1 + "))"
    # top-face
    top_p1 = str(c_X-offset) + " " + str(c_Y-offset) + " " + str(c_Z+offset)
    top_p2 = str(c_X-offset) + " " + str(c_Y+offset) + " " + str(c_Z+offset) 
    top_p3 = str(c_X+offset) + " " + str(c_Y+offset) + " " + str(c_Z+offset)
    top_p4 = str(c_X+offset) + " " + str(c_Y-offset) + " " + str(c_Z+offset)
    top_face = "((" + top_p1 + ", " + top_p2 + ", " + top_p3 + ", " + top_p4 +  ", " + top_p1 + "))"
    # front-face
    front_p1 = str(c_X-offset) + " " + str(c_Y-offset) + " " + str(c_Z-offset)
    front_p2 = str(c_X-offset) + " " + str(c_Y+offset) + " " + str(c_Z-offset) 
    front_p3 = str(c_X-offset) + " " + str(c_Y+offset) + " " + str(c_Z+offset) 
    front_p4 = str(c_X-offset) + " " + str(c_Y-offset) + " " + str(c_Z+offset)
    front_face = "((" + front_p1 + ", " + front_p2 + ", " + front_p3 + ", " + front_p4 + ", " + front_p1 + "))"
    # back-face             
    back_p1 = str(c_X+offset) + " " + str(c_Y-offset) + " " + str(c_Z-offset)
    back_p2 = str(c_X+offset) + " " + str(c_Y+offset) + " " + str(c_Z-offset) 
    back_p3 = str(c_X+offset) + " " + str(c_Y+offset) + " " + str(c_Z+offset) 
    back_p4 = str(c_X+offset) + " " + str(c_Y-offset) + " " + str(c_Z+offset)
    back_face = "((" + back_p1 + ", " + back_p2 + ", " + back_p3 + ", " + back_p4 + ", " + back_p1 + "))"
    # left-face
    left_p1 = str(c_X-offset) + " " + str(c_Y-offset) + " " + str(c_Z-offset)
    left_p2 = str(c_X+offset) + " " + str(c_Y-offset) + " " + str(c_Z-offset)
    left_p3 = str(c_X+offset) + " " + str(c_Y-offset) + " " + str(c_Z+offset)
    left_p4 = str(c_X-offset) + " " + str(c_Y-offset) + " " + str(c_Z+offset)
    left_face = "((" + left_p1 + ", " + left_p2 + ", " + left_p3 + ", " + left_p4 + ", " + left_p1 + "))"            
    # right-face
    right_p1 = str(c_X-offset) + " " + str(c_Y+offset) + " " + str(c_Z-offset)
    right_p2 = str(c_X+offset) + " " + str(c_Y+offset) + " " + str(c_Z-offset)
    right_p3 = str(c_X+offset) + " " + str(c_Y+offset) + " " + str(c_Z+offset)
    right_p4 = str(c_X-offset) + " " + str(c_Y+offset) + " " + str(c_Z+offset)
    right_face = "((" + right_p1 + ", " + right_p2 + ", " + right_p3 + ", " + right_p4 + ", " + right_p1 + "))"
    
    cuboid_face = bottom_face + ", " + top_face + ", " + front_face + ", " + back_face + ", " + left_face + ", " + right_face
    
    wktLiteral += "MULTIPOLYGON Z("
    try:
        wktLiteral += cuboid_face
    except e:
        return e
    print(cuboid_face)
    wktLiteral += ")"
    wktLiteral += "</geo:asWKT>"
    wktLiteral += "</rdf:Description>"
    wktLiteral += "</sf:MultiPolygon>"
    return wktLiteral
    
def polygon2WKT():
    wktLiteral = "<sf:POLYGON>";
    wktLiteral += "<rdf:Description rdf:about='" + exampleInstanceNamespace + str(name) + "'>";
    wktLiteral += "<geo:asWKT rdf:datatype='" + geoSparqlNamespace + "wktLiteral'>";
    wktLiteral += "POLYGON Z((";
    
    points =  geometry
    originP = points[0];
    
    wktLiteral += str(originP.X) + " " +  str(originP.Y) + " " +  str(originP.Z) # start point
    for i in range(1, len(points)):
        wktLiteral += ", " + str(points[i].X) + " " +  str(points[i].Y) + " " +  str(points[i].Z);       
    wktLiteral += ", " + str(originP.X) + " " +  str(originP.Y) + " " +  str(originP.Z); # end point
    wktLiteral += "))"
    
    wktLiteral += "</geo:asWKT>";
    wktLiteral += "</rdf:Description>";
    wktLiteral += "</sf:POLYGON>";
    return wktLiteral

#####
res = []
for geo_obj in geo_lst:
    geometry = geo_obj[0];
    name = geo_obj[1];
    geometryType = geo_obj[2];
    
    if(geometryType.upper() == "MULTIPOLYGON"):
        res.append(multipolygon2WKT(geometry))
        
    if(geometryType.upper() == "POLYGON"):
        res.append(polygon2WKT())

# Assign your output to the OUT variable.
OUT = res
# ----------------------------------------
rdf_wrapper_python_script = Python(IN[0]=rdf_prefixes.namespaces, IN[1]=wkt_converter)  # CPython3
# ---------- rdf_wrapper_python_script.python (35 lines) ----------
# Phython-Standard- und DesignScript-Bibliotheken laden
import sys
import clr
clr.AddReference('ProtoGeometry')
from Autodesk.DesignScript.Geometry import *

# Die Eingaben für diesen Block werden in Form einer Liste in den IN-Variablen gespeichert.
dataEnteringNode = IN

namespaces = dataEnteringNode[0]
inserts = dataEnteringNode[1]

# open RDF header
rdfStr = "<rdf:RDF";

# handle Namespaces
for key in namespaces:
    rdfStr += " xmlns:" + key + "='" + namespaces[key] + "'";

rdfStr += ">";

#add inserts

rdfStr += "<rdf:Description rdf:about='my:" + "RootModel" + "'>";

for insert in inserts:
    rdfStr += insert;

rdfStr += "</rdf:Description>"

# close RDF header
rdfStr += "</rdf:RDF>"

# Weisen Sie Ihre Ausgabe der OUT-Variablen zu.
OUT = rdfStr
# ----------------------------------------
watch = Watch(wkt_converter)

# group: RDF Export
file_path_2 = Filename("..\..\..\..\..\..\..\resources\rdf\example.rdf")
on_off_2 = BoolSelector(true)
switcher_2 = CodeBlock(SW=on_off_2, data=rdf_wrapper_python_script) { SW == "True"? data : null; }
writeText = FileSystem.WriteText(filePath=file_path_2, text=switcher_2)
watch_2 = Watch(switcher_2)

notes = CodeBlock()
# ---------- notes.designscript (8 lines) ----------
/**
* "F5": Run the script
* "Ctrl + I": Isolate Selected Geometry
*
*
*
*
**/;
# ----------------------------------------
code_block_2 = CodeBlock()
# ---------- code_block_2.designscript (11 lines) ----------
centroid = Point.ByCoordinates(0,0,2);
offset = 2/2;
c_X = 0;
c_Y = 0;
c_Z = 2;

bottom_p1 = Point.ByCoordinates(c_X-offset, c_Y-offset, c_Z-offset);
bottom_p2 = Point.ByCoordinates(c_X-offset, c_Y+offset, c_Z-offset);
bottom_p3 = Point.ByCoordinates(c_X+offset, c_Y+offset, c_Z-offset);
bottom_p4 = Point.ByCoordinates(c_X+offset, c_Y-offset, c_Z-offset);
bottom_face = [bottom_p1, bottom_p2, bottom_p3, bottom_p4];
# ----------------------------------------
code_block_3 = CodeBlock { 0; 0; 3; 1; 0; 0; }
byCoordinates = Point.ByCoordinates(x=code_block_3.out0, y=code_block_3.out1, z=code_block_3.out2)
byCoordinates_2 = Point.ByCoordinates(x=code_block_3.out3, y=code_block_3.out4, z=code_block_3.out5)
byStartPointEndPoint = Line.ByStartPointEndPoint(startPoint=byCoordinates, endPoint=byCoordinates_2)
code_block_4 = CodeBlock {  }
