# Dynamo graph QueryResultViewer.dyn (Dynamo 2.8.0.2471)
# packages: MeshToolkit 3.0.0

# group: Sphere testing
polygon1_name = Python()  # CPython3; unwired: IN[0], IN[1], IN[2]
# ---------- polygon1_name.python (40 lines) ----------
# Load the Python Standard and DesignScript Libraries
import sys
import clr
clr.AddReference('ProtoGeometry')
from Autodesk.DesignScript.Geometry import *

# The inputs to this node will be stored as a list in the IN variables.
#dataEnteringNode = IN
INDEX_EN = ['A','B','C','D'];
INDEX_NUM = ['1','2','3','4'];
INDEX = [];

if IN[2] == "EN":
    INDEX = INDEX_EN
if IN[2] == "NUM":
    INDEX = INDEX_NUM
"""
# Place your code below this line
def name_concatenation(geo_name:str, geo_number:int, index = INDEX):
    if geo_number > len(index):
        raise ValueError("No more indexes available!")
 
    geo_concat = [geo_name + index[i] for i in range(geo_number)]
    return geo_concat

def name_lst_concatenation(geo_name_lst:list, geo_number:int, index = INDEX):
    if geo_number > len(index):
        raise ValueError("No more indexes available!")
    
    geo_concat = [[geo_name + index[i] for i in range(geo_number)] for geo_name in geo_name_lst]
    return geo_concat


# Assign your output to the OUT variable.
if isinstance(IN[0], str):
    OUT = name_concatenation(IN[0], IN[1])
else:
    OUT = name_lst_concatenation(IN[0], IN[1])
"""
OUT = ""
# ----------------------------------------
code_block = CodeBlock()
# ---------- code_block.designscript (11 lines) ----------
centroid = Point.ByCoordinates(0,0,2);
offset = 2/2;
c_X = 0;
c_Y = 0;
c_Z = 2;

bottom_p1 = Point.ByCoordinates(c_X-offset, c_Y-offset, c_Z-offset);
bottom_p2 = Point.ByCoordinates(c_X-offset, c_Y+offset, c_Z-offset);
bottom_p3 = Point.ByCoordinates(c_X+offset, c_Y+offset, c_Z-offset);
bottom_p4 = Point.ByCoordinates(c_X+offset, c_Y-offset, c_Z-offset);
bottom_face = [bottom_p1, bottom_p2, bottom_p3, bottom_p4];
# ----------------------------------------
code_block_2 = CodeBlock { centroid = Point.ByCoordinates(-7, -3, 6); }
byCenterPointRadius = Sphere.ByCenterPointRadius()  # frozen
byGeometry = Autodesk.Dynamo.MeshToolkit.Mesh.ByGeometry(inputGeometry=byCenterPointRadius)
explode = Autodesk.Dynamo.MeshToolkit.Mesh.Explode(mesh=byGeometry)
watch = Watch(explode)
code_block_3 = CodeBlock(list=watch) { list; pol = list[0]; }
watch_2 = Watch(code_block_3.pol)
vertices = Autodesk.Dynamo.MeshToolkit.Mesh.Vertices(mesh=watch_2)
watch_3 = Watch(vertices)
watch_3d = Watch3D(watch_3)
triangleCentroids = Autodesk.Dynamo.MeshToolkit.Mesh.TriangleCentroids()  # unwired: mesh
code_block_4 = CodeBlock { 3; }
chop = List.Chop(list=triangleCentroids, lengths=code_block_4)

notes = CodeBlock()
# ---------- notes.designscript (8 lines) ----------
/**
* "F5": Run the script
* "Ctrl + I": Isolate Selected Geometry
* "Ctrl + P": Drag & Drop
*
*
*
**/;
# ----------------------------------------

# group: Background
geometry_highlighter = Python()  # CPython3; unwired: IN[0], IN[1], IN[2]
# ---------- geometry_highlighter.python (62 lines) ----------
# Load the Python Standard and DesignScript Libraries
import sys
import clr
clr.AddReference('ProtoGeometry')
from Autodesk.DesignScript.Geometry import *
clr.AddReference('DSCoreNodes')
from DSCore import *
clr.AddReference('GeometryColor')
from Modifiers import GeometryColor

###########################################################
def flatten(inp_lst):
# Core: 
#		1. traverse the input list 
#		2. concatenate each two adjacent elements 
#		3. store the concatenation into the output list
#		4. remove the non-list element out of the input list
    out_lst = []
    while True:
        if inp_lst == []:
            break
        for ind, val in enumerate(inp_lst):
            if type(val) == list:
                inp_lst = val + inp_lst[ind+1:]
                break
            else:
                out_lst.append(val)
                inp_lst.pop(ind)
                break
    return out_lst

def inList(res_lst, geo):
    flat_lst = flatten(res_lst)
    res = False
    
    for e in flat_lst:
        if e is None:
            break
        if geo.upper() == e.upper():
            res = True
            break
    return res
############################################################
# Input
geo_lst = IN[0]
res_lst = IN[1]
switch = IN[2]

#################################################
# Highlighter
colored_geo_lst = []
if switch:
    color = Color.ByARGB(255,255,0,0) # red
    
    for geo in geo_lst:
        geo_name = geo[1]
        if inList(res_lst, geo_name):  
            colored_geo = GeometryColor.ByGeometryColor(geo[3], color)
            colored_geo_lst.append(colored_geo)

#################################################
OUT = colored_geo_lst
# ----------------------------------------
watch_3d_2 = Watch3D(geometry_highlighter)
on_off_groundtruth = BoolSelector(false)
groundtruth = Python(IN[1]=on_off_groundtruth)  # CPython3; unwired: IN[0]
# ---------- groundtruth.python (75 lines) ----------
import sys
import clr
import itertools
clr.AddReference('ProtoGeometry')
from Autodesk.DesignScript.Geometry import *
clr.AddReference('DSCoreNodes')
from DSCore import *
clr.AddReference('GeometryColor')
from Modifiers import GeometryColor

#================= Help Function ====================
def getGeometry(geo_obj):
    return geo_obj[3]

#================= Input ====================
geo_lst = IN[0]
switch = IN[1]

#================= Body ====================
inter_geo_lst = []

"""
comparison algorithnm:

geo_obj_1 in lst start from 0 to n-1
    geo_obj_2 in lst start from 1 to n
lst remove geo_obj_1
"""
color = Color.ByARGB(230,230,250,0)
for i in range(0, len(geo_lst)-1):
    geo_obj_1 = geo_lst[i]
    geometry_1 = getGeometry(geo_obj_1)
    temp_lst = []

    geo_obj_1_has_intersection = False
    for j in range(1, len(geo_lst)):
        geo_obj_2 = geo_lst[j]
        geometry_2 = getGeometry(geo_obj_2)

        if Geometry.DoesIntersect(geometry_1, geometry_2):
            geo_obj_1_has_intersection = True
            
            colored_geometry_2 = GeometryColor.ByGeometryColor(geometry_2, color)
            temp_lst.append(colored_geometry_2)
    
    if geo_obj_1_has_intersection:
        colored_geometry_1 = GeometryColor.ByGeometryColor(geometry_1, color)
        temp_lst.append(colored_geometry_1)
    
    inter_geo_lst.append(temp_lst)

# remove duplicated from list 
output_lst = [] 
for geometry in inter_geo_lst: 
    if geometry not in output_lst: 
        output_lst.append(geometry) 
        
#output_lst = itertools.groupby(inter_geo_lst) # remove the duplicate(s)
#output_lst = inter_geo_lst

#================= Coloring ====================
"""
color = Color.ByARGB(230,230,250,0)
colored_output_lst = []

for geometry_lst in output_lst:
    temp_lst
    for geometry in geometry_lst:
        
        colored_geo = GeometryColor.ByGeometryColor(geometry, color)
        temp_lst
    colored_output_lst.append(colored_geo)
"""
#================= Output ====================
OUT = output_lst
# ----------------------------------------

# group: Geometry Selection
selection_board = CodeBlock()
# ---------- selection_board.designscript (11 lines) ----------
POINT = "POINT";
MULTIPOINT = "MULTIPOINT";
LINESTRING = "LINESTRING";
MULTILINESTRING = "MULTILINESTRING";
POLYGON = "POLYGON";
MULTIPOLYGON = "MULTIPOLYGON";
MULTIPOLYGON_ROTATION = "MULTIPOLYGON_ROTATION";
SPHERE = "MULTIPOLYGON-SPHERE";
GEOMETRYCOLLECTION = "GEOMETRYCOLLECTION";
geo_sel_lst=
["MULTIPOLYGON5"];
# ----------------------------------------
on_off = BoolSelector(false)
geometry_selector = Python(IN[1]=selection_board.geo_sel_lst, IN[2]=on_off)  # CPython3; unwired: IN[0]
# ---------- geometry_selector.python (45 lines) ----------
# Load the Python Standard and DesignScript Libraries
import sys
import clr
clr.AddReference('ProtoGeometry')
from Autodesk.DesignScript.Geometry import *
clr.AddReference('DSCoreNodes')
from DSCore import *
clr.AddReference('GeometryColor')
from Modifiers import GeometryColor

# Input
geo_lst = IN[0]
geo_sel_lst = IN[1]
switch = IN[2]


def inList(geo_sel_lst, geo):
    res = False
    for geo_sel in geo_sel_lst:
        if geo_sel is None:
            break
        if geo_sel.upper() == geo.upper():
            res = True
            break
    return res
#################################################
# Highlighter
colored_geo_lst = []
if switch:
    color = Color.ByARGB(138,43,226,0) # violet
    for geo in geo_lst:
        geo_name = geo[1]
        if inList(geo_sel_lst, geo_name):  
            geo_data = geo[0]
            colored_geo = ''
            if (geo[2].upper() == "LINESTRING" 
            or geo[2].upper() == "POLYGON" 
            or geo[2].upper() == "MULTIPOLYGON_ROTATION"):
                colored_geo = GeometryColor.ByGeometryColor(geo[3], color)
            else:
                colored_geo = GeometryColor.ByGeometryColor(geo_data, color)
            colored_geo_lst.append(colored_geo)

#################################################
OUT = colored_geo_lst
# ----------------------------------------
watch_3d_3 = Watch3D(geometry_selector)
watch_4 = Watch(watch_3d_3)

# group: RDF Import and Parsing
file_path = Filename("..\..\..\..\..\..\..\resources\JSON\xxl3DScene.json")
json_loader = Python(IN[0]=file_path)  # CPython3
# ---------- json_loader.python (22 lines) ----------
# Load the Python Standard and DesignScript Libraries
import sys
import clr
import json
import ctypes
clr.AddReference('ProtoGeometry')
from Autodesk.DesignScript.Geometry import *

# The inputs to this node will be stored as a list in the IN variables.
dir = IN[0]

warn_str = 'File or File Path does not exist.'

data = {}
try:
    with open(dir, 'r') as fp:
        data = json.load(fp)
except:
    ctypes.windll.user32.MessageBoxW(0, warn_str, 'Input Exception',1)

# Assign your output to the OUT variable.
OUT = data
# ----------------------------------------
json_viewer = Watch(json_loader)
on_off_loading_json = BoolSelector(true)
on_off_coloring_geometry = BoolSelector(true)
json_parser = Python(IN[0]=json_viewer, IN[1]=on_off_loading_json, IN[2]=on_off_coloring_geometry)  # CPython3
# ---------- json_parser.python (180 lines) ----------
import sys
import clr
import random
clr.AddReference('ProtoGeometry')
from Autodesk.DesignScript.Geometry import *
clr.AddReference('DSCoreNodes')
from DSCore import *
clr.AddReference('GeometryColor')
from Modifiers import GeometryColor
clr.AddReference('MeshToolkit')
from Autodesk.Dynamo.MeshToolkit import *

# Common Geometry Types
POINT = "POINT";
MULTIPOINT = "MULTIPOINT";
LINESTRING = "LINESTRING";
MULTILINESTRING = "MULTILINESTRING";
POLYGON = "POLYGON";
POLYGON_ROTATION = "POLYGON_ROTATION"
MULTIPOLYGON = "MULTIPOLYGON"
MULTIPOLYGON_ROTATION = "MULTIPOLYGON_ROTATION"
SPHERE = "MULTIPOLYGON_SPHERE"
GEOMETRYCOLLECTION = "GEOMETRYCOLLECTION";

# The inputs to this node will be stored as a list in the IN variables.
NUM_MULTIPOLYGON = 10
NUM_POLYGON = 10
NUM_LINESTRING = 10
NUM_POINT = 10

# Input 
json_file = IN[0]
switch_generator = IN[1]
switch_coloring = IN[2]

# output container
geo_lst = []

geo_pt_lst = []
geo_li_lst = []
geo_pol_lst = []
geo_mPol_lst = []
geo_sph_lst = []

geo_combi_lst = []

"""
def coloring(geometry):
    if switch_coloring:
        color = Color.ByARGB(230,230,250,0)
        return GeometryColor.ByGeometryColor(geometry, color)
    return geomery
"""

if switch_generator == False:
    OUT = []

for geo_name, geo_data in json_file.items():
    
    if ( geo_name.find('POINT') != -1 or
        geo_name.find('Point') != -1 ):

        pt_data = geo_data
        pt_x = 0.0
        pt_y = 0.0
        pt_z = 0.0
        if (len(pt_data) == 3): # (x, y, z)
            pt_x = pt_data[0]
            pt_y = pt_data[1]
            pt_z = pt_data[2]
            
        if (len(pt_data) == 2): # (x, y)
            pt_x = pt_data[0]
            pt_y = pt_data[1]
            pt_z = 0.0
            
        pt = Point.ByCoordinates(pt_x, pt_y, pt_z)

        geo_data = pt
        geo_name = geo_name.upper()
        geo_type = 'POINT'
        geometry = pt

        geo_pt_obj = (geo_data, geo_name, geo_type, geometry)
        geo_pt_lst.append(geo_pt_obj)
        continue

    if ( geo_name.find('LINESTRING') != -1 or
        geo_name.find('Linestring') != -1 or
        geo_name.find('LINE') != -1 or
        geo_name.find('Line') != -1 ):

        pt_lst = []
        for pt_data in geo_data[0]:
            pt = Point.ByCoordinates(pt_data[0], pt_data[1], pt_data[2])
            pt_lst.append(pt)

        geo_data = pt_lst
        geo_name = geo_name.upper()
        geo_type = 'LINESTRING'
        geometry = PolyCurve.ByPoints(pt_lst, False)

        geo_li_obj = (geo_data, geo_name, geo_type, geometry)
        geo_li_lst.append(geo_li_obj)
        continue

    if ( geo_name.find('SPHERE') != -1 or
        geo_name.find('Sphere') != -1 ):

        face_lst = []
        for face_data in geo_data:

            pt_lst = []
            for vert_data in face_data:
                pt = Point.ByCoordinates(vert_data[0], vert_data[1], vert_data[2])
                pt_lst.append(pt)
            face = Surface.ByPerimeterPoints(pt_lst)
            face_lst.append(face)

        geo_data = face_lst
        geo_name = geo_name.upper()
        geo_type = 'MULTIPOLYGON_SPHERE'
        geometry = face_lst

        geo_sph_obj = (geo_data, geo_name, geo_type, geometry)
        geo_sph_lst.append(geo_sph_obj)
        continue

    if ( geo_name.find('MULTIPOLYGON') != -1 or
        geo_name.find('Multipolygon') != -1  or
        geo_name.find('CUBE') != -1 or
        geo_name.find('Cube') != -1 ):

        face_lst = []
        for face_data in geo_data:

            pt_lst = []
            for vert_data in face_data:
                pt = Point.ByCoordinates(vert_data[0], vert_data[1], vert_data[2])
                pt_lst.append(pt)
                # print()
            face = Surface.ByPerimeterPoints(pt_lst)
            # face = []
            face_lst.append(face)

        geo_data = face_lst
        geo_name = geo_name.upper()
        geo_type = 'MULTIPOLYGON'
        geometry = face_lst

        geo_mPol_obj = (geo_data, geo_name, geo_type, geometry)
        geo_mPol_lst.append(geo_mPol_obj)
        continue

    if ( geo_name.find('POLYGON') != -1 or 
        geo_name.find('Polygon') != -1 ):
        
        pt_lst = []
        for vert_data in geo_data[0]:
            pt = Point.ByCoordinates(vert_data[0], vert_data[1], vert_data[2])
            pt_lst.append(pt)
            # print()
        face = Surface.ByPerimeterPoints(pt_lst)
        #face = []

        geo_data = pt_lst
        geo_name = geo_name.upper()
        geo_type = 'POLYGON'
        geometry = face
        # geometry = geo_data

        geo_pol_obj = (geo_data, geo_name, geo_type, geometry)
        geo_pol_lst.append(geo_pol_obj)
        continue

    
geo_combi_lst = geo_pt_lst + geo_li_lst + geo_pol_lst + geo_mPol_lst + geo_sph_lst

######################### Output ############################
OUT = geo_combi_lst
# ----------------------------------------
watch_5 = Watch(json_parser)

# group: XML(query result) Import and Parsing
on_off_import = BoolSelector(true)
file_path_2 = Filename("..\..\..\..\..\..\..\resources\rdf\query_result.xml")
fileExists = FileSystem.FileExists(path=file_path_2)
watch_6 = Watch(file_path_2)
xml_parser = Python(IN[0]=fileExists, IN[1]=watch_6)  # CPython3
# ---------- xml_parser.python (88 lines) ----------
# Load the Python Standard and DesignScript Libraries
import sys
import clr
import ctypes
import xml.etree.ElementTree as ET
sys.path.append(r"C:\Users\yhe\AppData\Local\Programs\Python\Python310\Lib\site-packages")

clr.AddReference('ProtoGeometry')
from Autodesk.DesignScript.Geometry import *
from xml.dom.minidom import parse, parseString

#dir = "r'C:\\Users\\nobita_yhe\\Workspace\\ExtendingJena\\src\\main\\resources\\rdf\\query_result.xml'"
#dir = r'C:\Users\nobita_yhe\Workspace\ExtendingJena\src\main\resources\rdf\query_result.xml'
warn_str = 'File or File Path does not exist.'
res = ''
######################################################

def xmlParsing2Uri(path=dir):
    """ it returns the list in structure like [[uri1, uri2],...,[uri1, uri2]]"""
    dom = parse(path)
    data = dom.documentElement
    resList = data.getElementsByTagName('result')
    
    res_lst = []
    for res in resList: # handle the <result>...</result>
        ur_lst = []
        for bi in res.getElementsByTagName('binding'): # handle the <binding>...</binding>
            for ur in bi.getElementsByTagName('uri'):
                ur_lst.append(ur.childNodes[0].nodeValue)
        res_lst.append(ur_lst)
        ur_lst = []
    return res_lst


def xml2GeometryString(path=dir):
    """ it returns the list in structure like [[Geomety1, Geomety2],...,[Geomety1, Geomety2]]"""
    dom = parse(path)
    data = dom.documentElement
    resList = data.getElementsByTagName('result')
    seperator = '#'

    res_lst = []
    for res in resList: # handle the <result>...</result>
        ur_lst = []
        for bi in res.getElementsByTagName('binding'): # handle the <binding>...</binding>
            for ur in bi.getElementsByTagName('uri'):
                uri_str = ur.childNodes[0].nodeValue
                geo_index = uri_str.find(seperator) 
                geo_str = uri_str[geo_index+1:]
                ur_lst.append(geo_str)
        res_lst.append(ur_lst)
        ur_lst = []
    return res_lst

def xml2GeoInDynamo(path=dir):
    #with open(r'C:\Users\nobita_yhe\Workspace\ExtendingJena\src\main\resources\rdf\query_result.xml', 'r', encoding='utf-8') as file:
    with open(path, 'r', encoding='utf-8') as file:
        xml_data = file.read()
        dom = parseString(xml_data)
        #dom = parse(xml_data)
        data = dom.documentElement
        resList = data.getElementsByTagName('result')
        seperator = '#'
        
        res_lst = []
        for res in resList: # handle the <result>...</result>
            ur_lst = []
            for bi in res.getElementsByTagName('binding'): # handle the <binding>...</binding>
                for ur in bi.getElementsByTagName('uri'):
                    uri_str = ur.childNodes[0].nodeValue
                    geo_index = uri_str.find(seperator) 
                    geo_str = uri_str[geo_index+1:]
                    ur_lst.append(geo_str)
            res_lst.append(ur_lst)
            ur_lst = []
    return res_lst
    
######################################################

if IN[0] == True:
    dir = IN[1]
    res = xml2GeoInDynamo(dir)
else:
	ctypes.windll.user32.MessageBoxW(0, warn_str, 'Input Exception',1)
	res = warn_str
######################################################
# Assign your output to the OUT variable.
OUT = res
# ----------------------------------------
switcher = CodeBlock(SW=on_off_import, data=xml_parser) { SW == "True"? data : null; }
query_result_viewer = Watch(switcher)

# group: Highlight of Query Result + Groundtruth
query_result_selector = Python(IN[0]=query_result_viewer, IN[1]=json_viewer)  # CPython3
# ---------- query_result_selector.python (37 lines) ----------
# Load the Python Standard and DesignScript Libraries
import sys
import clr
clr.AddReference('ProtoGeometry')
from Autodesk.DesignScript.Geometry import *

def flatten(inp_lst):
# Core: 
#		1. traverse the input list 
#		2. concatenate each two adjacent elements 
#		3. store the concatenation into the output list
#		4. remove the non-list element out of the input list
    out_lst = []
    while True:
        if inp_lst == []:
            break
        for ind, val in enumerate(inp_lst):
            if type(val) == list:
                inp_lst = val + inp_lst[ind+1:]
                break
            else:
                out_lst.append(val)
                inp_lst.pop(ind)
                break
    return out_lst
    
###################################################
res_lst = flatten(IN[0])
geo_dict = IN[1]

res_dict = {}
for res in res_lst:
    
    if res in geo_dict.keys():
        res_dict[res] = geo_dict[res]

OUT = res_dict
# ----------------------------------------
watch_7 = Watch(query_result_selector)
on_off_query_result_viewer = BoolSelector(true)
json_parser_2 = Python(IN[0]=query_result_selector, IN[1]=on_off_query_result_viewer)  # CPython3
# ---------- json_parser_2.python (176 lines) ----------
import sys
import clr
import random
clr.AddReference('ProtoGeometry')
from Autodesk.DesignScript.Geometry import *
clr.AddReference('DSCoreNodes')
from DSCore import *
clr.AddReference('GeometryColor')
from Modifiers import GeometryColor
clr.AddReference('MeshToolkit')
from Autodesk.Dynamo.MeshToolkit import *

# Common Geometry Types
POINT = "POINT";
MULTIPOINT = "MULTIPOINT";
LINESTRING = "LINESTRING";
MULTILINESTRING = "MULTILINESTRING";
POLYGON = "POLYGON";
POLYGON_ROTATION = "POLYGON_ROTATION"
MULTIPOLYGON = "MULTIPOLYGON"
MULTIPOLYGON_ROTATION = "MULTIPOLYGON_ROTATION"
SPHERE = "MULTIPOLYGON_SPHERE"
GEOMETRYCOLLECTION = "GEOMETRYCOLLECTION";

# The inputs to this node will be stored as a list in the IN variables.
NUM_MULTIPOLYGON = 10
NUM_POLYGON = 10
NUM_LINESTRING = 10
NUM_POINT = 10

# Input 
json_file = IN[0]
switch_coloring = IN[1]

# output container
geo_lst = []

geo_pt_lst = []
geo_li_lst = []
geo_pol_lst = []
geo_mPol_lst = []
geo_sph_lst = []

geo_combi_lst = []


def coloring(geometry):
    if switch_coloring:
        color = Color.ByARGB(255,255,0,0)
        return GeometryColor.ByGeometryColor(geometry, color)
    else:
        return geomery

for geo_name, geo_data in json_file.items():
    
    if ( geo_name.find('POINT') != -1 or
        geo_name.find('Point') != -1 ):

        pt_data = geo_data
        pt_x = 0.0
        pt_y = 0.0
        pt_z = 0.0
        if (len(pt_data) == 3): # (x, y, z)
            pt_x = pt_data[0]
            pt_y = pt_data[1]
            pt_z = pt_data[2]
            
        if (len(pt_data) == 2): # (x, y)
            pt_x = pt_data[0]
            pt_y = pt_data[1]
            pt_z = 0.0
            
        pt = Point.ByCoordinates(pt_x, pt_y, pt_z)

        geo_data = pt
        geo_name = geo_name.upper()
        geo_type = 'POINT'
        geometry = coloring(pt)

        geo_pt_obj = (geo_data, geo_name, geo_type, geometry)
        geo_pt_lst.append(geo_pt_obj)
        continue

    if ( geo_name.find('LINESTRING') != -1 or
        geo_name.find('Linestring') != -1 or
        geo_name.find('LINE') != -1 or
        geo_name.find('Line') != -1 ):

        pt_lst = []
        for pt_data in geo_data[0]:
            pt = Point.ByCoordinates(pt_data[0], pt_data[1], pt_data[2])
            pt_lst.append(pt)

        geo_data = pt_lst
        geo_name = geo_name.upper()
        geo_type = 'LINESTRING'
        geometry = coloring(PolyCurve.ByPoints(pt_lst, False))

        geo_li_obj = (geo_data, geo_name, geo_type, geometry)
        geo_li_lst.append(geo_li_obj)
        continue

    if ( geo_name.find('SPHERE') != -1 or
        geo_name.find('Sphere') != -1 ):

        face_lst = []
        for face_data in geo_data:

            pt_lst = []
            for vert_data in face_data:
                pt = Point.ByCoordinates(vert_data[0], vert_data[1], vert_data[2])
                pt_lst.append(pt)
            face = coloring(Surface.ByPerimeterPoints(pt_lst))
            face_lst.append(face)

        geo_data = face_lst
        geo_name = geo_name.upper()
        geo_type = 'MULTIPOLYGON_SPHERE'
        geometry = face_lst

        geo_sph_obj = (geo_data, geo_name, geo_type, geometry)
        geo_sph_lst.append(geo_sph_obj)
        continue

    if ( geo_name.find('MULTIPOLYGON') != -1 or
        geo_name.find('Multipolygon') != -1  or
        geo_name.find('CUBE') != -1 or
        geo_name.find('Cube') != -1 ):

        face_lst = []
        for face_data in geo_data:

            pt_lst = []
            for vert_data in face_data:
                pt = Point.ByCoordinates(vert_data[0], vert_data[1], vert_data[2])
                pt_lst.append(pt)
                # print()
            face = coloring(Surface.ByPerimeterPoints(pt_lst))
            # face = []
            face_lst.append(face)

        geo_data = face_lst
        geo_name = geo_name.upper()
        geo_type = 'MULTIPOLYGON'
        geometry = face_lst

        geo_mPol_obj = (geo_data, geo_name, geo_type, geometry)
        geo_mPol_lst.append(geo_mPol_obj)
        continue

    if ( geo_name.find('POLYGON') != -1 or 
        geo_name.find('Polygon') != -1 ):
        
        pt_lst = []
        for vert_data in geo_data[0]:
            pt = Point.ByCoordinates(vert_data[0], vert_data[1], vert_data[2])
            pt_lst.append(pt)
            # print()
        face = coloring(Surface.ByPerimeterPoints(pt_lst))
        #face = []

        geo_data = pt_lst
        geo_name = geo_name.upper()
        geo_type = 'POLYGON'
        geometry = face
        # geometry = geo_data

        geo_pol_obj = (geo_data, geo_name, geo_type, geometry)
        geo_pol_lst.append(geo_pol_obj)
        continue

    
geo_combi_lst = geo_pt_lst + geo_li_lst + geo_pol_lst + geo_mPol_lst + geo_sph_lst

######################### Output ############################
OUT = geo_combi_lst
# ----------------------------------------
